# Grasshopper definition mmObjectExport.ghx (Grasshopper 0.9.76)

planesrf = PlaneSurface(Plane=PlaneXY(0, 0, 0), XSize=Domain(-10, 10), YSize=Domain(-10, 10))
mesh = Mesh(planesrf)
mesh_2 = Mesh(planesrf)
mesh_3 = Mesh(planesrf)
mesh_4 = Mesh(planesrf)
mesh_5 = Mesh(planesrf)
mesh_6 = Mesh(planesrf)
mesh_7 = Mesh(planesrf)
mesh_8 = Mesh(planesrf)
number_slider = Slider(1, range=0..1)
dom = ConstructDomain(DomainStart=Slider(4, range=0..10), DomainEnd=Slider(10, range=0..10))
mmjourney = MMJourney(
    StartPortals=[mesh_6, mesh_8],
    StartWeights=number_slider,
    EndPortals=mesh_7,
    EndWeights=number_slider,
    DwellWeights=number_slider,
    DwellTime=dom,
    AgentNum="50",
    SimTime="0 to 40",
    Name="afawfe")
journey = CSharpScript(
    startPortals=[mesh_6, mesh_7, mesh_8],
    endPortals=mesh_7,
    dwellPortals=[mesh_8, mesh_7, mesh_6],
    dwellTime=dom,
    agentNum="50",
    simTime="0 to 40",
    name="2-1")  # -> out, A; inputs startPortals: tree of Mesh, startWeights: tree, endPortals: tree of Mesh, endWeights: tree, dwellPortals: tree of Mesh, dwellWeights: tree of Double, agentNum: String, name: String
# ---------- journey: C# ----------
    if (startPortals.BranchCount != 0 &&
      endPortals.BranchCount != 0 &&
      agentNum != null &&
      simTime != null &&
      name != null)
    {

      string journeyName = dwellPortals.AllData().Count != 0 ? "Circulate: " + name : "Journey: " + name;
      string startWeightsString;
      string endWeightsString;
      string dwellWeightsString;

      List<string> startPortalIDs = new List<string>();
      List<string> endPortalIDs = new List<string>();
      List<string> dwellPortalIDs = new List<string>();

      foreach (Mesh portal in startPortals.AllData()){
        var id = Guid.NewGuid().ToString();
        portal.SetUserString(journeyName, id);
        startPortalIDs.Add(id);
      }
      foreach (Mesh portal in endPortals.AllData()){
        var id = Guid.NewGuid().ToString();
        portal.SetUserString(journeyName, id);
        endPortalIDs.Add(id);
      }
      foreach (Mesh portal in dwellPortals.AllData()){
        var id = Guid.NewGuid().ToString();
        portal.SetUserString(journeyName, id);
        dwellPortalIDs.Add(id);
      }

      if (endWeights.AllData().Count() == endPortals.AllData().Count()) {
        endWeightsString = SerializeList(endWeights.AllData());
      } else if (endWeights.BranchCount == 0) {
        endWeightsString = SerializeList(AverageNumList(endPortalIDs.Count()));
      } else {
        Print("WARNING: end weight count not equal to end portal count: using uniform distribution");
        endWeightsString = SerializeList(AverageNumList(endPortalIDs.Count()));
      }
      if (startWeights.AllData().Count() == startPortals.AllData().Count()) {
        startWeightsString = SerializeList(startWeights.AllData());
      } else if (startWeights.BranchCount == 0) {
        startWeightsString = SerializeList(AverageNumList(startPortalIDs.Count()));
      } else {
        Print("WARNING: start weight count not equal to start portal count: using uniform distribution");
        startWeightsString = SerializeList(AverageNumList(startPortalIDs.Count()));
      }

      Attribute _temp = new Attribute("Attributes");

      if ( dwellPortalIDs.Count != 0){

        if (!simTime.IncludesInterval(dwellTime)) {
          Print("WARNING: dwellTime not within simTime: running dwellTime for entire Simulation");
          dwellTime = simTime;
        }
        if (dwellWeights.AllData().Count() == dwellPortals.AllData().Count()) {
          dwellWeightsString = SerializeList(dwellWeights.AllData());
        } else if (dwellWeights.BranchCount == 0) {
          dwellWeightsString = SerializeList(AverageNumList(dwellPortalIDs.Count()));
        } else {
          Print("WARNING: dwell weight count not equal to dwell portal count: using uniform distribution");
          dwellWeightsString = SerializeList(AverageNumList(dwellPortalIDs.Count()));
        }

        _temp.AddDataTypeVectorWeightedGlobalIDAttribute("AttrCirculateEventCirculatePortals",
          SerializeList(dwellPortalIDs),
          dwellWeightsString); // weights
        _temp.AddDataTypeBoolAttribute("AttrCirculateEventCirculateWaitOnStart", "0");
        _temp.AddDataTypeEnumAttribute("AttrCirculateEventCirculateWaitStyle", "WaitSpreadOut", "2");
        _temp.AddDataTypeDistributionAttribute("AttrCirculateEventLifetimeCountDistribution",
          "Uniform",
          "[0.000000,10.000000]"); // work this out later
        _temp.AddDataTypeDistributionAttribute("AttrCirculateEventLifetimeDurationDistribution",
          "Uniform",
          SerializeList(new List<double> {dwellTime[0] * 60F, dwellTime[1] * 60F}));
        _temp.AddDataTypeDataTypeTimeReferenceAttribute("AttrEventCirculateLifetimeEndTime",
          "00000000-0000-0000-0000-000000000000",
          TimeInSeconds(dwellTime[1]));
        _temp.AddDataTypeEnumAttribute("AttrCirculateEventLifetimeType", "LifetimeForever", "0");
        _temp.AddDataTypeBoolAttribute("AttrCirculateEventLifetimeWaitAfterCount", "0");


      }
      _temp.AddDataTypeBoolAttribute("AttrEnabled", "1");
      _temp.AddDataTypeActionAttribute("AttrEventBirthAction", "ActionNone");
      _temp.AddDataTypeAttribute("AttrEventBirthProfile", "00000000-0000-0000-0000-000000000000", "DataTypeGlobalID");
      _temp.AddDataTypeAttribute("AttrEventDemandCurveData", "[]", "DataTypeVectorDouble");
      _temp.AddDataTypeEnumAttribute("AttrEventDemandType", "DemandDistribution", "2");
      _temp.AddDataTypeEnumAttribute("AttrEventDestinationType", "DestinationAssigned", "1");
      _temp.AddDataTypeDistributionAttribute("AttrEventDurationDistribution",
        "Uniform",
        SerializeList(new List<double> {simTime[0] * 60F, simTime[1] * 60F}));
      _temp.AddDataTypeVectorWeightedGlobalIDAttribute("AttrEventMultiDestination",
        SerializeList(endPortalIDs),
        endWeightsString); // weights
      _temp.AddDataTypeVectorWeightedGlobalIDAttribute("AttrEventMultiOrigin",
        SerializeList(startPortalIDs),
        startWeightsString);
      _temp.AddDataTypeAttribute("AttrEventPopulation", agentNum, "DataTypeInt");
      _temp.AddDataTypeDataTypeTimeReferenceAttribute("AttrEventStartTime",
        "00000000-0000-0000-0000-000000000000",
        TimeInSeconds(simTime[0]));

      foreach (Mesh portal in startPortals.AllData()){
        portal.SetUserString(portal.GetUserString(journeyName), _temp.ToString());
      }
      foreach (Mesh portal in endPortals.AllData()){
        portal.SetUserString(portal.GetUserString(journeyName), _temp.ToString());
      }
      foreach (Mesh portal in startPortals.AllData()){
        portal.SetUserString(portal.GetUserString(journeyName), _temp.ToString());
      }

      A = journeyName;
    }
# ---------- journey: C# additional code ----------
  private string TimeInSeconds (double num)
  {
    List <string> timeInSeconds = new List<string> { "00","00","00" };
    timeInSeconds[0] = NumToTimeString(Math.Floor(num / 60));
    timeInSeconds[1] = NumToTimeString(num % 60);
    return String.Join(":", timeInSeconds.ToArray());
  }

  private string NumToTimeString(double num)
  {
    if ( num.ToString().Length < 2 ) {
      return "0" + num.ToString();
    } else {
      return num.ToString();
    }
  }

  private string SerializeList<T>(List<T> lst)
  {
    string serialized = "[]";
    List<string> serializedList = new List<string>();

    foreach( var item in lst) {
      serializedList.Add(item.ToString());
    }
    return serialized.Insert(1, String.Join(",", serializedList.ToArray()));
  }

  private List<float> AverageNumList (double num)
  {
    List<float> averages = new List<float>();
    float average = (1F / (float) num);
    for (int i = 0; i < num; i++) averages.Add(average);
    return averages;
  }

  //private string GetWeightsString (string



  private class Attribute
  {
    private string _name;
    private string _v;
    private string _t;
    private Dictionary<string, Attribute> _attr = new Dictionary<string, Attribute>();

    public Attribute(string name)
    {
      this._name = name;
    }
    public string Name {get { return this._name; }}
    public string V {
      get { return this._v; }
      set { this._v = value; }
    }
    public string T {
      get { return this._t; }
      set { this._t = value; }
    }
    public Dictionary<string, Attribute> Attributes {get { return this._attr; }}


    public void AddAttribute(string name, string v, string t)
    {
      var attr = new Attribute(name);
      this._attr.Add(name, attr);
      if ( v != "") { attr.V = v; }
      if ( t != "") { attr.T = t; }
    }

    public void AddNestedAttribute(string name, List<List<string>> subAttr)
    {
      this.AddAttribute(name, "", "");
      foreach (List<string> attr in subAttr)
      {
        this.Attributes[name].AddAttribute(attr[0], attr[1], attr[2]);
      }
    }

    public override string ToString(){
      string parsed = "<" + this.Name.ToString();

      if (this.V != null){
        parsed += " v=" + "\"" + this.V + "\" ";
      }
      if (this.T != null){
        parsed += " t=" + "\"" + this.T + "\" ";
      }
      parsed += ">";

      foreach (string key in this.Attributes.Keys){
        parsed += this.Attributes[key].ToString();
      }

      return parsed + "</" + this.Name.ToString() + ">";
    }

    /*
     * Mass Motion specific XML types
     */
    public void AddDataTypeAttribute(string name, string data, string type)
    {
      this.AddNestedAttribute(name, new List < List < string >> {
          new List < string > {"Data", data, "1"},
          new List < string > {"Type", type, "3"}
          });
    }

    public void AddDataTypeBoolAttribute(string name, string data)
    {
      this.AddNestedAttribute(name, new List < List < string >> {
          new List < string > {"Data", data, "0"},
          new List < string > {"Type", "DataTypeBool", "3"}
          });
    }

    public void AddDataTypeEnumAttribute(string name, string enumString, string enumValue)
    {
      this.AddAttribute(name, "", "");
      this.Attributes[name].AddNestedAttribute("Data", new List < List < string >> {
          new List < string > {"EnumString", enumString, "3"},
          new List < string > {"EnumValue", enumValue, "1"}
          });
      this.Attributes[name].AddAttribute("Type", "DataTypeEnum", "3");
    }

    public void AddDataTypeVectorWeightedGlobalIDAttribute(string name, string ids, string weights)
    {
      this.AddAttribute(name, "", "");
      this.Attributes[name].AddNestedAttribute("Data", new List < List < string >> {
          new List < string > {"GlobalIDs", ids, "3"}, // list of GUIDs
          new List < string > {"WeightedType", "WeightedNone", "3"},
          new List < string > {"Weights", weights, "2"} // weighted average
          });
      this.Attributes[name].AddAttribute("Type", "DataTypeVectorWeightedGlobalID", "3");
    }

    public void AddDataTypeDataTypeTimeReferenceAttribute(string name, string guid, string time)
    {
      this.AddAttribute(name, "", ""); // cannot add optional parameters
      this.Attributes[name].AddNestedAttribute("Data", new List < List < string >> {
          new List < string > {"GlobalID", guid, "3"},
          new List < string > {"TimeInSeconds", time, "3"},
          new List < string > {"TimeType", "TimeSimulationStart", "3"}
          });
      this.Attributes[name].AddAttribute("Type", "DataTypeTimeReference", "3");
    }

    public void AddDataTypeDistributionAttribute(string name, string type, string values)
    {
      this.AddAttribute(name, "", "");
      this.Attributes[name].AddNestedAttribute("Data", new List < List < string >> {
          new List < string > {"Type", type, "3"},
          new List < string > {"Values", values, "2"} // weighted average
          });
      this.Attributes[name].AddAttribute("Type", "DataTypeDistribution", "3");
    }

    public void AddDataTypeActionAttribute(string name, string action)
    {
      this.AddAttribute(name, "", "");
      this.Attributes[name].AddNestedAttribute("Data", new List < List < string >> {
          new List < string > {"ActionType", action, "3"},
          });
      this.Attributes[name].AddAttribute("Type", "DataTypeAction", "3");
    }
  }
# ---------- end journey ----------
collection = CSharpScript(geometry=[mesh_4, mesh_3], name="walls")  # -> out, A; inputs geometry: tree of GeometryBase, name: String
# ---------- collection: C# ----------
    if ( name != null && geometry.AllData().Count != 0)
    {
      foreach(GeometryBase geo in geometry.AllData()) {
        var id = Guid.NewGuid().ToString();
        geo.SetUserString(name, id);
      }
      A = "Collection: " + name;
    }
# ---------- end collection ----------
panel = Panel(collection.A)
panel_2 = Panel(mmjourney)
panel_3 = Panel(journey.A)
panel_4 = Panel("C:\My Documents\_TEMP\Rhino\Grasshopper\MassMotion\Git\massmotion-export\test")
md_slider = MDSlider(slider_value=Point(0.5, 0.5, 0.5), SliderMode=0, x_domain=Domain(0, 1), y_domain=Domain(0, 1), z_domain=Domain(0, 1))
line = LineSDL(Start=md_slider, Direction=Vector(0, 0, 1), Length=1)
mmxml_export = CSharpScript(
    floors=[mesh, mesh_2],
    barriers=[mesh_4, mesh_3],
    links=mesh_5,
    portals=[mesh_6, mesh_7, mesh_8],
    collections=collection.A,
    journeys=journey.A,
    simTime=" 0 to 150",
    filePath=panel_4,
    fileName="rhino_export",
    run=Toggle(False))  # -> out, A; inputs floors: tree of Mesh, barriers: tree of Mesh, paths: tree of Polyline, links: tree of Mesh, portals: tree of Mesh, geometry: tree of Mesh, collections: tree of String, journeys: tree of String, filePath: String, fileName: String, run: Boolean
# ---------- mmxml_export: C# ----------
                                                /*                                                                                                                                                                                                                    /*
     * Script written by <Luis Jaggy>
     */

    List<Rhino.Geometry.Mesh> floorList = floors.AllData();
    List<Rhino.Geometry.Mesh> barrierList = barriers.AllData();
    List<Rhino.Geometry.Polyline> pathList = paths.AllData();
    List<Rhino.Geometry.Mesh> linkList = links.AllData();
    List<Rhino.Geometry.Mesh> portalList = portals.AllData();
    List<Rhino.Geometry.Mesh> geometryList = geometry.AllData();
    collectionList = collections.AllData();
    journeyList = journeys.AllData();
    collectionDict = new Dictionary<string, List<string>>();
    journeyDict = new Dictionary<string, string>();



    if (run && fileName != null)
    {
      string pathString = System.IO.Path.Combine(filePath, "gh_out");
      System.IO.Directory.CreateDirectory(pathString);
      string path = pathString + "//" + fileName + ".mmxml";

      using (FileStream filestream = new FileStream(path, FileMode.Create))
      using (StreamWriter sw = new StreamWriter(filestream))
      using (XmlTextWriter writer = new XmlTextWriter(sw))
      {
        writer.Formatting = Formatting.Indented;
        writer.Indentation = 4;

        writer.WriteStartDocument();
        writer.WriteComment("Script written by <Luis Jaggy>");
        writer.WriteStartElement("DataRoot");
        writer.WriteAttributeString("FormatVersion", "1");
        writer.WriteAttributeString("ContentVersion", "8.0.9.0");
        writer.WriteAttributeString("FileName", "");

        writer.WriteStartElement("Objects");

        for (int i = 0; i < portalList.Count; i++)
        {
          MMPortal mmPortal = new MMPortal(portalList[i], writer, i.ToString());
          UpdateJourneys(portalList[i], mmPortal.GlobalID);
          mmPortal.Write();
        }
        for (int i = 0; i < linkList.Count; i++)
        {
          MMLink mmLink = new MMLink(linkList[i], writer, i.ToString());
          UpdateCollections(linkList[i], mmLink.GlobalID);
          mmLink.Write();
        }
        for (int i = 0; i < pathList.Count; i++)
        {
          MMPath mmPath = new MMPath(pathList[i], writer, i.ToString());
          mmPath.Write();
        }
        for (int i = 0; i < barrierList.Count; i++)
        {
          MMBarrier mmBarrier = new MMBarrier(barrierList[i], writer, i.ToString());
          UpdateCollections(barrierList[i], mmBarrier.GlobalID);
          mmBarrier.Write();
        }
        for (int i = 0; i < floorList.Count; i++)
        {
          MMFloor mmFloor = new MMFloor(floorList[i], writer, i.ToString());
          UpdateCollections(floorList[i], mmFloor.GlobalID);
          mmFloor.Write();
        }
        for (int i = 0; i < geometryList.Count; i++)
        {
          MMVisOnly mmVisOnly = new MMVisOnly(geometryList[i], writer, i.ToString());
          UpdateCollections(geometryList[i], mmVisOnly.GlobalID);
          mmVisOnly.Write();
        }
        foreach(string key in collectionDict.Keys)
        {
          MMCollection mmCollection = new MMCollection(collectionDict[key], writer, key);
          mmCollection.Write();
        }
        foreach(string key in journeyDict.Keys)
        {
          MMCirculate mmCirculate = new MMCirculate(journeyDict[key], writer, key);
          mmCirculate.Write();
        }
        writer.WriteEndElement();


        writer.WriteStartElement("Settings");
        if (simTime == null){
          writer.WriteElementString("Attributes", " ");
        } else {
          writer.WriteStartElement("Attributes");
          writer.WriteStartElement("AttrSettingsSimTimeRange");
          writer.WriteStartElement("Data");
          writer.WriteStartElement("BoundedEndTime");
          writer.WriteAttributeString("v", TimeInSeconds(simTime[1]));
          writer.WriteAttributeString("t", "3");
          writer.WriteEndElement();
          writer.WriteStartElement("BoundedStartTime");
          writer.WriteAttributeString("v", TimeInSeconds(simTime[0]));
          writer.WriteAttributeString("t", "3");
          writer.WriteEndElement();
          writer.WriteStartElement("TimeRangeType");
          writer.WriteAttributeString("v", "TimeRangeBounded");
          writer.WriteAttributeString("t", "3");

          writer.WriteEndElement();

          writer.WriteEndElement();
          writer.WriteStartElement("Type");
          writer.WriteAttributeString("v", "DataTypeTimeRange");
          writer.WriteAttributeString("t", "3");
          writer.WriteEndElement();
        }
        writer.WriteEndElement();

        writer.WriteEndElement();
        writer.WriteEndDocument();

        Print("File written as " + path);
        //System.Diagnostics.Process.Start("explorer.exe", pathString);

      }
    }
# ---------- mmxml_export: C# additional code ----------
  /*
  * Script_Instance variables
  */
  List<string> collectionList;
  List<string> journeyList;
  Dictionary<string, List<string>> collectionDict;
  Dictionary<string, string> journeyDict;

  /*
   * Utiliy functions
   */
  private void UpdateCollections(Rhino.Geometry.GeometryBase geo, string id)
  {
    foreach ( string collection in collectionList)
    {

      string _collection = collection.Split(':')[1].Trim();

      if (geo.GetUserStrings().AllKeys.Contains(_collection)){
        if (!collectionDict.ContainsKey(_collection)) {
          collectionDict.Add(_collection, new List<string>());
        }
        collectionDict[_collection].Add(id);
      }
    }
  }
  private void UpdateJourneys(Rhino.Geometry.GeometryBase geo, string id)
  {
    foreach ( string journey in journeyList )
    {
      if (geo.GetUserStrings().AllKeys.Contains(journey)){

        string _GUID = geo.GetUserString(journey);
        string _journey = geo.GetUserString(_GUID);

        if (!journeyDict.ContainsKey(journey)) {
          journeyDict.Add(journey, _journey);
        }
        journeyDict[journey] = journeyDict[journey].Replace(_GUID, id);
      }
    }
  }

  private string TimeInSeconds (double num)
  {
    List <string> timeInSeconds = new List<string> { "00","00","00" };
    timeInSeconds[0] = NumToTimeString(Math.Floor(num / 60));
    timeInSeconds[1] = NumToTimeString(num % 60);
    return String.Join(":", timeInSeconds.ToArray());
  }

  private string NumToTimeString(double num)
  {
    if ( num.ToString().Length < 2 ) {
      return "0" + num.ToString();
    } else {
      return num.ToString();
    }
  }

  /*
   * * * * *
   * MassMotionObject SuperClass that handles geometry conversion to Xml
   */
  abstract class MMObject
  {
    public XmlTextWriter _Writer;
    public string _GlobalID;
    public string _ID;
    public string _Name;
    public string _ObjectSubType;
    public string _ObjectType = "Actor";

    // constructor method
    public MMObject(XmlTextWriter writer, string tag)
    {
      this._ID = "_temp" + tag;
      this._GlobalID = Guid.NewGuid().ToString();
      this._Writer = writer;
    }

    public string Name { get { return this._Name; }}
    public XmlTextWriter Writer { get { return this._Writer; }}
    public string GlobalID {
      get { return this._GlobalID; }
      set { this._GlobalID = value; }
    }
    public string ID {get { return this._ID; }}
    public string ObjectSubType { get { return this._ObjectSubType; }}
    public string ObjectType { get { return this._ObjectType; }}

    // Write this Geometry's attributes to Xml
    public void Write()
    {
      this.Writer.WriteStartElement(this.Name);

      WriteAttributes();
      WriteBody();
      WriteProperty("GlobalID", this.GlobalID, 3);
      WriteProperty("ID", this.ID, 1);
      WriteProperty("Name", this.Name, 3);
      WriteProperty("ObjectSubType", this.ObjectSubType, 3);
      WriteProperty("ObjectType", this.ObjectType, 3);

      this.Writer.WriteEndElement();
    }

    // Write the attributes element of this object
    public virtual void WriteAttributes()
    {
      this.Writer.WriteElementString("Attributes", " ");
    }

    // Write the body element of this object
    // this method can probably be removed
    public virtual void WriteBody()
    {
      this.Writer.WriteStartElement("Body");
      this.Writer.WriteElementString("Attributes", " ");
      this.Writer.WriteElementString("Geometry", " ");
      this.Writer.WriteEndElement();
    }

    // method to write a generic property to the xml file
    public void WriteProperty(string property, string val, int t)
    {
      this.Writer.WriteStartElement(property);
      this.Writer.WriteAttributeString("v", val);
      this.Writer.WriteAttributeString("t", t.ToString());
      this.Writer.WriteEndElement();
    }

    // method to write an object attribute to the xml file
    public void WriteAttribute(string attr, string data, int datat, string type, int typet)
    {
      this.Writer.WriteStartElement(attr);
      WriteProperty("Data", data, datat);
      WriteProperty("Type", type, typet);
      this.Writer.WriteEndElement();
    }

    // method to write the geometry element of a mesh
    public void WriteMeshGeometry(Rhino.Geometry.Mesh msh)
    {
      this.Writer.WriteStartElement("Geometry");
      WriteProperty("Faces", SerializeMeshFaces(msh), 1);
      WriteProperty("GeometryType", "MeshGeometry", 3);
      WriteProperty("Vertices", SerializeMeshVertices(msh), 2);
      this.Writer.WriteEndElement();
    }

    // method to write the geometry element of a polyline
    public void WritePolyLineGeometry(Rhino.Geometry.Polyline pline)
    {
      this.Writer.WriteStartElement("Geometry")
        ;
      this.Writer.WriteStartElement("CurveData");
      this.WriteProperty("RawPoints", SerializePolylineVertices(pline), 2);
      this.Writer.WriteEndElement();

      this.WriteProperty("EdgeRadius", "0.050000", 2);
      this.WriteProperty("GeometryType", "PolylineGeometry", 3);
      this.WriteProperty("VertexRadius", "0.100000", 2);
      this.Writer.WriteEndElement();
    }

    // Returns a string of serialized mesh faces (flattened)
    public string SerializeMeshFaces(Rhino.Geometry.Mesh msh)
    {
      string serialized = "[]";
      List<string> faces = new List<string>();

      msh.Vertices.CombineIdentical(false, false);

      foreach (Rhino.Geometry.MeshFace face in msh.Faces){
        faces.Add(face.A.ToString());
        faces.Add(face.B.ToString());
        faces.Add(face.C.ToString());
        if (face.IsQuad) {
          faces.Add(face.A.ToString());
          faces.Add(face.C.ToString());
          faces.Add(face.D.ToString());
        }
      }
      return serialized.Insert(1, String.Join(",", faces.ToArray()));
    }

    // Returns a string of serialized mesh vertices (flattened)
    public string SerializeMeshVertices(Rhino.Geometry.Mesh msh)
    {
      string serialized = "[]";
      List<string> coords = new List<string>();

      foreach (Rhino.Geometry.Point3d pt in msh.Vertices){
        coords.Add(pt.X.ToString());
        coords.Add(pt.Z.ToString());
        coords.Add((-pt.Y).ToString());
      }
      return serialized.Insert(1, String.Join(",", coords.ToArray()));
    }

    // Returns a string of serialized polyline vertices (flattened)
    public string SerializePolylineVertices(Rhino.Geometry.Polyline pline)
    {
      string serialized = "[]";
      List<string> coords = new List<string>();

      foreach (Rhino.Geometry.Point3d pt in pline){
        coords.Add(pt.X.ToString());
        coords.Add(pt.Z.ToString());
        coords.Add((-pt.Y).ToString());
      }
      return serialized.Insert(1, String.Join(",", coords.ToArray()));
    }

    // Returns a string of serialized list items
    public string SerializeList<T>(List<T> lst)
    {
      string serialized = "[]";
      List<string> serializedList = new List<string>();

      foreach( var item in lst) {
        serializedList.Add(item.ToString());
      }
      return serialized.Insert(1, String.Join(",", serializedList.ToArray()));
    }

    // ## not working
    public string SerializeMeshEdges(Rhino.Geometry.Mesh msh)
    {
      string serialized = "[]";
      return serialized;
    }

    // Returns a joined mesh from a list of meshes
    public Mesh JoinMeshes(List<Mesh> meshes)
    {
      var msh = new Rhino.Geometry.Mesh();
      foreach(Rhino.Geometry.Mesh m in meshes)
      {
        msh.Append(m);
      }
      return msh;
    }
  }


  /*
   * MassMotionCollection Class
   */
  class MMCollection : MMObject
  {

    List<string> _IDs;

    public MMCollection(List<string> ids, XmlTextWriter writer, string tag)
      : base(writer, tag)
    {
      this._ObjectSubType = "GroupCollection";
      this._ObjectType = "Group";
      this._Name = tag;
      this._IDs = ids;
    }

    public List<string> IDs {get {return this._IDs; }}

    public override void WriteAttributes()
    {

      List<float> averages = new List<float>();
      int count = this.IDs.Count;
      for (int i = 0; i < count; i++)
      {
        float average = (1F / count);
        averages.Add(average);
      }

      this.Writer.WriteStartElement("Attributes");
      this.Writer.WriteStartElement("AttrCollectionBaseMembers");
      this.Writer.WriteStartElement("Data");
      this.WriteProperty("GlobalIDs", this.SerializeList(this.IDs), 3);
      this.WriteProperty("WeightedType", "WeightedNone", 3);
      this.WriteProperty("Weights", this.SerializeList(averages), 2);
      this.Writer.WriteEndElement();
      this.WriteProperty("Type", "DataTypeVectorWeightedGlobalID", 3);
      this.Writer.WriteEndElement();
      this.Writer.WriteEndElement();
    }

    public override void WriteBody()
    {
    }
  }

  /*
   * MassMotion Circulation and Journey Class
   */
  class MMCirculate : MMObject
  {
    private string _attr;

    public MMCirculate(string attr, XmlTextWriter writer, string tag)
      : base(writer, tag)
    {
      this._ObjectSubType = tag.Split(':')[0] == "Journey" ? "EventJourney" : "EventCirculate";
      //this._ObjectSubType = "EventCirculate";
      this._ObjectType = "Event";
      this._Name = tag.Replace(" ", "");
      this._attr = attr;
    }
    public string Attributes { get { return this._attr; }}

    public override void WriteAttributes()
    {
      this.Writer.WriteRaw(this.Attributes);
    }

    public override void WriteBody()
    {
    }
  }


  /*
   * MassMotionFloor Class
   */
  class MMFloor : MMObject
  {
    Rhino.Geometry.Mesh _msh;

    //constructor method
    public MMFloor(Rhino.Geometry.Mesh msh, XmlTextWriter writer, string tag)
      : base(writer, tag)
    {
      this._msh = msh;
      this._ObjectSubType = "FloorActor";
      this._Name = this.Mesh.ToString().Replace(".", "_") + this.ObjectSubType + tag;
    }
    // return the mesh geometry of this object
    public Rhino.Geometry.Mesh Mesh { get { return this._msh; }}

    // Write the body element of this object
    public override void WriteBody()
    {
      this.Writer.WriteStartElement("Body");
      this.WriteMeshGeometry(this.Mesh);
      this.Writer.WriteEndElement();
    }
  }

  /*
   * MassMotionBarrier Class
   */
  class MMBarrier : MMObject
  {
    Rhino.Geometry.Mesh _msh;

    //constructor method
    public MMBarrier(Rhino.Geometry.Mesh msh, XmlTextWriter writer, string tag)
      : base(writer, tag)
    {
      this._msh = msh;
      this._ObjectSubType = "BarrierActor";
      this._Name = this.Mesh.ToString().Replace(".", "_") + this.ObjectSubType + tag;
    }
    // return the mesh geometry of this object
    public Rhino.Geometry.Mesh Mesh { get { return this._msh; }}

    // Write the body element of this object
    public override void WriteBody()
    {
      this.Writer.WriteStartElement("Body");
      this.WriteMeshGeometry(this.Mesh);
      this.Writer.WriteEndElement();
    }
  }

  /*
   * MassMotionLink Class
   */
  class MMLink : MMObject
  {
    Rhino.Geometry.Mesh _msh;

    // contructor method
    public MMLink(Rhino.Geometry.Mesh msh, XmlTextWriter writer, string tag)
      : base(writer, tag)
    {
      this._msh = msh;
      this._msh.Translate(new Vector3d(0, 0, 0.05));
      this._ObjectSubType = "LinkActor";
      this._Name = this.Mesh.ToString().Replace(".", "_") + this.ObjectSubType + tag;
    }
    // return the mesh geometry of this object
    public Rhino.Geometry.Mesh Mesh { get { return this._msh; }}

    // Write the body element of this object
    public override void WriteBody()
    {

      this.Writer.WriteStartElement("Body");

      this.Writer.WriteStartElement("Attributes");
      this.WriteAttribute("AttrCEActorGoalPointPositions",
        this.SerializeMeshVertices(this.Mesh), 2,
        "DataTypeVectorDouble", 3);
      this.WriteAttribute("AttrCEActorGoalVertexIndices",
        "[1,3,2,0]", 1,
        "DataTypeVectorInt", 3);
      this.Writer.WriteEndElement();
      this.WriteMeshGeometry(this.Mesh);
      this.Writer.WriteEndElement();
    }
  }
  /*
   * MassMotionPortal Class
   */
  class MMPortal : MMObject
  {
    Rhino.Geometry.Mesh _msh;

    // contructor method
    public MMPortal(Rhino.Geometry.Mesh msh, XmlTextWriter writer, string tag)
      : base(writer, tag)
    {
      this._msh = msh;
      this._msh.Translate(new Vector3d(0, 0, 0.05));
      this._ObjectSubType = "PortalActor";
      this._Name = this.Mesh.ToString().Replace(".", "_") + this.ObjectSubType + tag;
    }
    // return the mesh geometry of this object
    public Rhino.Geometry.Mesh Mesh { get { return this._msh; }}

    // Write the body element of this object
    // This currently is not outputting the correct locations for:
    //  - AttrPortalGoalEdgeIndices and
    //  - AttrPortalGoalPointPositions
    public override void WriteBody()
    {
      this.Writer.WriteStartElement("Body");

      this.Writer.WriteStartElement("Attributes");
      this.WriteAttribute("AttrPortalGoalEdgeIndices",
        "[1,4]", 1,
        "DataTypeVectorInt", 3);
      this.WriteAttribute("AttrPortalGoalPointPositions",
        "temp", 2,
        "DataTypeVectorDouble", 3);
      this.Writer.WriteEndElement();
      this.WriteMeshGeometry(this.Mesh);
      this.Writer.WriteEndElement();
    }
  }

  /*
   * MassMotionPath Class
   */
  class MMPath : MMObject
  {
    Rhino.Geometry.Polyline _pline;

    public MMPath(Rhino.Geometry.Polyline pline, XmlTextWriter writer, string tag)
      : base(writer, tag)
    {
      this._pline = pline;
      this._ObjectSubType = "PathActor";
      this._Name = this.Pline.ToString().Replace(".", "_") + this.ObjectSubType + tag;
    }
    // return the polyline geometry of this object
    public Rhino.Geometry.Polyline Pline { get { return this._pline; }}

    // Write the body element of this object
    public override void WriteBody()
    {
      this.Writer.WriteStartElement("Body");
      this.WritePolyLineGeometry(this.Pline);
      this.Writer.WriteEndElement();
    }
  }

  /*
   * MassMotion VisualizationOnly Class
   */
  class MMVisOnly : MMObject
  {
    Rhino.Geometry.Mesh _msh;

    //constructor method
    public MMVisOnly(Rhino.Geometry.Mesh msh, XmlTextWriter writer, string tag)
      : base(writer, tag)
    {
      this._msh = msh;
      this._ObjectSubType = "VisOnlyActor";
      this._Name = this.Mesh.ToString().Replace(".", "_") + this.ObjectSubType + tag;
    }
    // return the mesh geometry of this object
    public Rhino.Geometry.Mesh Mesh { get { return this._msh; }}

    // Write the body element of this object
    public override void WriteBody()
    {
      this.Writer.WriteStartElement("Body");
      this.WriteMeshGeometry(this.Mesh);
      this.Writer.WriteEndElement();
    }
  }
# ---------- end mmxml_export ----------
