# Grasshopper definition mmObjectExport.ghx (Grasshopper 0.9.76)

geo = Geometry(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)  # disabled

geo_2 = Geometry(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)  # disabled
geo_3 = Geometry(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)  # disabled
panel = Panel("FLOOR_1_WALLS")  # disabled
panel_2 = Panel("FLOOR_0_WALLS")  # disabled
mesh = Mesh(geo_3)  # disabled
mesh_2 = Mesh(geo_2)  # disabled
collection = CSharpScript(geometry=mesh, name=panel)  # -> out, A; inputs geometry: list of GeometryBase, name: String; disabled
# ---------- collection: C# ----------
    foreach(GeometryBase geo in geometry) {
      geo.SetUserString("collection", name);
    }
    A = geometry;
# ---------- end collection ----------
collection_2 = CSharpScript(geometry=mesh_2, name=panel_2)  # -> out, A; inputs geometry: list of GeometryBase, name: String; disabled; same code as collection

geo_4 = Geometry([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])  # disabled
geo_5 = Geometry([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])  # disabled
panel_3 = Panel("FLOOR_0")  # disabled
panel_4 = Panel("FLOOR_1")  # disabled
mesh_3 = Mesh(geo_5)  # disabled
mesh_4 = Mesh(geo_4)  # disabled
collection_3 = CSharpScript(geometry=mesh_3, name=panel_3)  # -> out, A; inputs geometry: list of GeometryBase, name: String; disabled; same code as collection
collection_4 = CSharpScript(geometry=mesh_4, name=panel_4)  # -> out, A; inputs geometry: list of GeometryBase, name: String; disabled; same code as collection

mesh_5 = Mesh(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)
mesh_6 = Mesh(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)
mesh_7 = Mesh(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)
mesh_8 = Mesh(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)
mesh_9 = Mesh([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])
mesh_10 = Mesh([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])
mesh_11 = Mesh(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)
mesh_12 = Mesh(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)  # disabled
mesh_13 = Mesh(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)  # disabled
mesh_14 = Mesh(geo)  # disabled
panel_5 = Panel("100")  # disabled
panel_6 = Panel("10 to 90")  # disabled
panel_7 = Panel("50 to 60")  # disabled
panel_8 = Panel("1-3")  # disabled
journey = CSharpScript(startPortals=mesh_13, endPortals=mesh_12, dwellTime=panel_7, agentNum=panel_5, simTime=panel_6, name=panel_8)  # -> out, A; inputs startPortals: list of Mesh, endPortals: list of Mesh, dwellPortals: list of Mesh, agentNum: String, name: String; disabled
# ---------- journey: C# ----------
    string journeyName = dwellPortals.Count != 0 ? "Circulate: " + name : "Journey: " + name;

    List<string> startPortalIDs = new List<string>();
    List<string> endPortalIDs = new List<string>();
    List<string> dwellPortalIDs = new List<string>();

    foreach (Mesh portal in startPortals){
      var id = Guid.NewGuid().ToString();
      portal.SetUserString(journeyName, id);
      startPortalIDs.Add(id);
    }
    foreach (Mesh portal in endPortals){
      var id = Guid.NewGuid().ToString();
      portal.SetUserString(journeyName, id);
      endPortalIDs.Add(id);
    }
    foreach (Mesh portal in dwellPortals){
      var id = Guid.NewGuid().ToString();
      portal.SetUserString(journeyName, id);
      dwellPortalIDs.Add(id);
    }

    Attribute _temp = new Attribute("Attributes");

    if ( dwellPortals.Count != 0){
      _temp.AddDataTypeVectorWeightedGlobalIDAttribute("AttrCirculateEventCirculatePortals",
        SerializeList(dwellPortalIDs),
        new List < string > { "1" , "2" }); // weights
      _temp.AddDataTypeBoolAttribute("AttrCirculateEventCirculateWaitOnStart", "0");
      _temp.AddDataTypeEnumAttribute("AttrCirculateEventCirculateWaitStyle", "WaitSpreadOut", "2");
      _temp.AddDataTypeDistributionAttribute("AttrCirculateEventLifetimeCountDistribution",
        "Uniform",
        "[0.000000,10.000000]"); // work this out later
      _temp.AddDataTypeDistributionAttribute("AttrCirculateEventLifetimeDurationDistribution",
        "Uniform",
        SerializeList(new List<double> {dwellTime[0] * 60F, dwellTime[1] * 60F}));
      _temp.AddDataTypeDataTypeTimeReferenceAttribute("AttrEventCirculateLifetimeEndTime",
        "00000000-0000-0000-0000-000000000000",
        TimeInSeconds(dwellTime[1]));
      _temp.AddDataTypeEnumAttribute("AttrCirculateEventLifetimeType", "LifetimeForever", "0");
      _temp.AddDataTypeBoolAttribute("AttrCirculateEventLifetimeWaitAfterCount", "0");
    }
    _temp.AddDataTypeBoolAttribute("AttrEnabled", "1");
    _temp.AddDataTypeActionAttribute("AttrEventBirthAction", "ActionNone");
    _temp.AddDataTypeAttribute("AttrEventBirthProfile", "00000000-0000-0000-0000-000000000000", "DataTypeGlobalID");
    _temp.AddDataTypeAttribute("AttrEventDemandCurveData", "[]", "DataTypeVectorDouble");
    _temp.AddDataTypeEnumAttribute("AttrEventDemandType", "DemandDistribution", "2");
    _temp.AddDataTypeEnumAttribute("AttrEventDestinationType", "DestinationAssigned", "1");
    _temp.AddDataTypeDistributionAttribute("AttrEventDurationDistribution",
      "Uniform",
      SerializeList(new List<double> {simTime[0] * 60F, simTime[1] * 60F}));
    _temp.AddDataTypeVectorWeightedGlobalIDAttribute("AttrEventMultiDestination",
      SerializeList(endPortalIDs),
      new List < string > { "1" , "2" }); // weights
    _temp.AddDataTypeVectorWeightedGlobalIDAttribute("AttrEventMultiOrigin",
      SerializeList(startPortalIDs),
      new List < string > { "1" , "2" });
    _temp.AddDataTypeAttribute("AttrEventPopulation", agentNum, "DataTypeInt");
    _temp.AddDataTypeDataTypeTimeReferenceAttribute("AttrEventStartTime",
      "00000000-0000-0000-0000-000000000000",
      TimeInSeconds(simTime[0]));

    foreach (Mesh portal in startPortals){
      portal.SetUserString(portal.GetUserString(journeyName), _temp.ToString());
    }
    foreach (Mesh portal in endPortals){
      portal.SetUserString(portal.GetUserString(journeyName), _temp.ToString());
    }
    foreach (Mesh portal in startPortals){
      portal.SetUserString(portal.GetUserString(journeyName), _temp.ToString());
    }

    A = journeyName;
# ---------- journey: C# additional code ----------
  private string TimeInSeconds (double num)
  {
    List <string> timeInSeconds = new List<string> { "00","00","00" };
    timeInSeconds[0] = NumToTimeString(Math.Floor(num / 60));
    timeInSeconds[1] = NumToTimeString(num % 60);
    return String.Join(":", timeInSeconds.ToArray());
  }

  private string NumToTimeString(double num)
  {
    if ( num.ToString().Length < 2 ) {
      return "0" + num.ToString();
    } else {
      return num.ToString();
    }
  }

  public string SerializeList<T>(List<T> lst)
  {
    string serialized = "[]";
    List<string> serializedList = new List<string>();

    foreach( var item in lst) {
      serializedList.Add(item.ToString());
    }
    return serialized.Insert(1, String.Join(",", serializedList.ToArray()));
  }


  private class Attribute
  {
    private string _name;
    private string _v;
    private string _t;
    private Dictionary<string, Attribute> _attr = new Dictionary<string, Attribute>();

    public Attribute(string name)
    {
      this._name = name;
    }
    public string Name {get { return this._name; }}
    public string V {
      get { return this._v; }
      set { this._v = value; }
    }
    public string T {
      get { return this._t; }
      set { this._t = value; }
    }
    public Dictionary<string, Attribute> Attributes {get { return this._attr; }}


    public void AddAttribute(string name, string v, string t)
    {
      var attr = new Attribute(name);
      this._attr.Add(name, attr);
      if ( v != "") { attr.V = v; }
      if ( t != "") { attr.T = t; }
    }

    public void AddNestedAttribute(string name, List<List<string>> subAttr)
    {
      this.AddAttribute(name, "", "");
      foreach (List<string> attr in subAttr)
      {
        this.Attributes[name].AddAttribute(attr[0], attr[1], attr[2]);
      }
    }

    public override string ToString(){
      string parsed = "<" + this.Name.ToString();

      if (this.V != null){
        parsed += " v=" + "\"" + this.V + "\" ";
      }
      if (this.T != null){
        parsed += " t=" + "\"" + this.T + "\" ";
      }
      parsed += ">";

      foreach (string key in this.Attributes.Keys){
        parsed += this.Attributes[key].ToString();
      }

      return parsed + "</" + this.Name.ToString() + ">";
    }

    /*
     * Mass Motion specific XML types
     */
    public void AddDataTypeAttribute(string name, string data, string type)
    {
      this.AddNestedAttribute(name, new List < List < string >> {
          new List < string > {"Data", data, "1"},
          new List < string > {"Type", type, "3"}
          });
    }

    public void AddDataTypeBoolAttribute(string name, string data)
    {
      this.AddNestedAttribute(name, new List < List < string >> {
          new List < string > {"Data", data, "0"},
          new List < string > {"Type", "DataTypeBool", "3"}
          });
    }

    public void AddDataTypeEnumAttribute(string name, string enumString, string enumValue)
    {
      this.AddAttribute(name, "", "");
      this.Attributes[name].AddNestedAttribute("Data", new List < List < string >> {
          new List < string > {"EnumString", enumString, "3"},
          new List < string > {"EnumValue", enumValue, "1"}
          });
      this.Attributes[name].AddAttribute("Type", "DataTypeEnum", "3");
    }

    public void AddDataTypeVectorWeightedGlobalIDAttribute(string name, string ids, List<string> weights)
    {
      this.AddAttribute(name, "", "");
      this.Attributes[name].AddNestedAttribute("Data", new List < List < string >> {
          new List < string > {"GlobalIDs", ids, "3"}, // list of GUIDs
          new List < string > {"WeightedType", "WeightedNone", "3"},
          new List < string > {"Weights", "[]", "2"} // weighted average
          });
      this.Attributes[name].AddAttribute("Type", "DataTypeVectorWeightedGlobalID", "3");
    }

    public void AddDataTypeDataTypeTimeReferenceAttribute(string name, string guid, string time)
    {
      this.AddAttribute(name, "", ""); // cannot add optional parameters
      this.Attributes[name].AddNestedAttribute("Data", new List < List < string >> {
          new List < string > {"GlobalID", guid, "3"},
          new List < string > {"TimeInSeconds", time, "3"},
          new List < string > {"TimeType", "TimeSimulationStart", "3"}
          });
      this.Attributes[name].AddAttribute("Type", "DataTypeTimeReference", "3");
    }

    public void AddDataTypeDistributionAttribute(string name, string type, string values)
    {
      this.AddAttribute(name, "", "");
      this.Attributes[name].AddNestedAttribute("Data", new List < List < string >> {
          new List < string > {"Type", type, "3"},
          new List < string > {"Values", values, "2"} // weighted average
          });
      this.Attributes[name].AddAttribute("Type", "DataTypeDistribution", "3");
    }
    
    public void AddDataTypeActionAttribute(string name, string action)
    {
      this.AddAttribute(name, "", "");
      this.Attributes[name].AddNestedAttribute("Data", new List < List < string >> {
          new List < string > {"ActionType", action, "3"},
          });
      this.Attributes[name].AddAttribute("Type", "DataTypeAction", "3");
    }
  }
# ---------- end journey ----------
panel_9 = Panel("C:\My Documents\_TEMP\Rhino\Grasshopper\MassMotion\Git\massmotion-export\test")  # disabled
journey_2 = CSharpScript(startPortals=mesh_6, endPortals=mesh_5, dwellTime="5 to 30", agentNum="100", simTime="0 to 40", name="1-2")  # -> out, A; inputs startPortals: list of Mesh, endPortals: list of Mesh, dwellPortals: list of Mesh, agentNum: String, name: String; same code as journey
journey_3 = CSharpScript(startPortals=mesh_5, endPortals=mesh_6, dwellTime="10 to 20", agentNum="50", simTime="10 to 40", name="2-1")  # -> out, A; inputs startPortals: list of Mesh, endPortals: list of Mesh, dwellPortals: list of Mesh, agentNum: String, name: String; same code as journey
panel_10 = Panel(journey.A)  # disabled
panel_11 = Panel(journey_2.A)
panel_12 = Panel(journey_3.A)
collection_5 = CSharpScript(geometry=mesh_7, name="FLOOR_1_WALLS")  # -> out, A; inputs geometry: list of GeometryBase, name: String; same code as collection
collection_6 = CSharpScript(geometry=mesh_10, name="FLOOR_0")  # -> out, A; inputs geometry: list of GeometryBase, name: String; same code as collection
collection_7 = CSharpScript(geometry=mesh_9, name="FLOOR_1")  # -> out, A; inputs geometry: list of GeometryBase, name: String; same code as collection
collection_8 = CSharpScript(geometry=mesh_8, name="FLOOR_0_WALLS")  # -> out, A; inputs geometry: list of GeometryBase, name: String; same code as collection
panel_13 = Panel("C:\My Documents\_TEMP\Rhino\Grasshopper\MassMotion\Git\massmotion-export\test")
panel_14 = Panel("rhino_export")  # disabled
toggle = BooleanToggle(False)  # disabled
panel_15 = Panel(" 0 to 150")  # disabled
mass_motion_export = CSharpScript(
    floors=[collection_4.A, collection_3.A],
    barriers=[collection_2.A, collection.A],
    links=mesh_14,
    portals=[mesh_13, mesh_12],
    journeys=journey.A,
    simTime=panel_15,
    filePath=panel_9,
    fileName=panel_14,
    run=toggle)  # -> out, A; inputs floors: tree of Mesh, barriers: tree of Mesh, paths: tree of Polyline, links: tree of Mesh, portals: tree of Mesh, geometry: tree of Mesh, journeys: tree of String, filePath: String, fileName: String, run: Boolean; disabled
# ---------- mass_motion_export: C# ----------
                        /*                                                                                                                                                                                                                    /*
     * Script written by <Luis Jaggy>
     */

    List<Rhino.Geometry.Mesh> floorList = floors.AllData();
    List<Rhino.Geometry.Mesh> barrierList = barriers.AllData();
    List<Rhino.Geometry.Polyline> pathList = paths.AllData();
    List<Rhino.Geometry.Mesh> linkList = links.AllData();
    List<Rhino.Geometry.Mesh> portalList = portals.AllData();
    List<Rhino.Geometry.Mesh> geometryList = geometry.AllData();
    List<string> journeylist = journeys.AllData();

    Dictionary<string, List<string>> collectionDict = new Dictionary<string, List<string>>();
    Dictionary<string, string> journeyDict = new Dictionary<string, string>();
    
    if (run && fileName != null)
    {
      string pathString = System.IO.Path.Combine(filePath, "gh_out");
      System.IO.Directory.CreateDirectory(pathString);
      string path = pathString + "//" + fileName + ".mmxml";

      using (FileStream filestream = new FileStream(path, FileMode.Create))
      using (StreamWriter sw = new StreamWriter(filestream))
      using (XmlTextWriter writer = new XmlTextWriter(sw))
      {
        writer.Formatting = Formatting.Indented;
        writer.Indentation = 4;

        writer.WriteStartDocument();
        writer.WriteComment("Script written by <Luis Jaggy>");
        writer.WriteStartElement("DataRoot");
        writer.WriteAttributeString("FormatVersion", "1");
        writer.WriteAttributeString("ContentVersion", "8.0.9.0");
        writer.WriteAttributeString("FileName", "");

        writer.WriteStartElement("Objects");

        //
        for (int i = 0; i < portalList.Count; i++)
        {
          MMPortal mmPortal = new MMPortal(portalList[i], writer, i.ToString());

          // journey handling
          foreach ( string journey in journeylist )
          {
            if ( portalList[i].GetUserStrings().AllKeys.Contains(journey)){

              string _GUID = portalList[i].GetUserString(journey);
              string _journey = portalList[i].GetUserString(_GUID);

              if (!journeyDict.ContainsKey(journey)) {
                journeyDict.Add(journey, _journey);
              }
              journeyDict[journey] = journeyDict[journey].Replace(_GUID, mmPortal.GlobalID);
            }
          }

          AddOrUpdateDict(portalList[i], "collection", mmPortal.GlobalID, collectionDict);
          mmPortal.Write();
        }
        //


        for (int i = 0; i < linkList.Count; i++)
        {
          MMLink mmLink = new MMLink(linkList[i], writer, i.ToString());
          AddOrUpdateDict(linkList[i], "collection", mmLink.GlobalID, collectionDict);
          mmLink.Write();
        }
        for (int i = 0; i < pathList.Count; i++)
        {
          MMPath mmPath = new MMPath(pathList[i], writer, i.ToString());
          mmPath.Write();
        }
        for (int i = 0; i < barrierList.Count; i++)
        {
          MMBarrier mmBarrier = new MMBarrier(barrierList[i], writer, i.ToString());
          AddOrUpdateDict(barrierList[i], "collection", mmBarrier.GlobalID, collectionDict);
          mmBarrier.Write();
        }
        for (int i = 0; i < floorList.Count; i++)
        {
          MMFloor mmFloor = new MMFloor(floorList[i], writer, i.ToString());
          AddOrUpdateDict(floorList[i], "collection", mmFloor.GlobalID, collectionDict);
          mmFloor.Write();
        }
        for (int i = 0; i < geometryList.Count; i++)
        {
          MMVisOnly mmVisOnly = new MMVisOnly(geometryList[i], writer, i.ToString());
          mmVisOnly.Write();
        }
        foreach(string key in collectionDict.Keys)
        {
          MMCollection mmCollection = new MMCollection(collectionDict[key], writer, key);
          mmCollection.Write();
        }
        foreach(string key in journeyDict.Keys)
        {
          MMCirculate mmCirculate = new MMCirculate(journeyDict[key], writer, key);
          mmCirculate.Write();
        }

        writer.WriteEndElement();
        writer.WriteStartElement("Settings");
        if (simTime == null){
          writer.WriteElementString("Attributes", " ");
        } else {
          writer.WriteStartElement("Attributes");
          writer.WriteStartElement("AttrSettingsSimTimeRange");
          writer.WriteStartElement("Data");
          writer.WriteStartElement("BoundedEndTime");
          writer.WriteAttributeString("v", TimeInSeconds(simTime[1]));
          writer.WriteAttributeString("t", "3");
          writer.WriteEndElement();
          writer.WriteStartElement("BoundedStartTime");
          writer.WriteAttributeString("v", TimeInSeconds(simTime[0]));
          writer.WriteAttributeString("t", "3");
          writer.WriteEndElement();
          writer.WriteStartElement("TimeRangeType");
          writer.WriteAttributeString("v", "TimeRangeBounded");
          writer.WriteAttributeString("t", "3");

          writer.WriteEndElement();

          writer.WriteEndElement();
          writer.WriteStartElement("Type");
          writer.WriteAttributeString("v", "DataTypeTimeRange");
          writer.WriteAttributeString("t", "3");
          writer.WriteEndElement();
        }
        writer.WriteEndElement();

        writer.WriteEndElement();
        writer.WriteEndDocument();

        //System.Diagnostics.Process.Start("explorer.exe", pathString);

      }
    }
# ---------- mass_motion_export: C# additional code ----------
  /*
  * Utiliy methods
  */

  public void AddOrUpdateDict(Rhino.Geometry.GeometryBase geo, string key, string val, Dictionary<string, List<string>> dict)
  {
    var userStrings = geo.GetUserStrings();
    if (userStrings.AllKeys.Contains(key)){
      var name = userStrings[key];
      if (dict.ContainsKey(name)) {
        dict[name].Add(val);
      } else {
        List<string> lst = new List<string>();
        lst.Add(val);
        dict.Add(name, lst);

      }
    }
  }
  private string TimeInSeconds (double num)
  {
    List <string> timeInSeconds = new List<string> { "00","00","00" };
    timeInSeconds[0] = NumToTimeString(Math.Floor(num / 60));
    timeInSeconds[1] = NumToTimeString(num % 60);
    return String.Join(":", timeInSeconds.ToArray());
  }

  private string NumToTimeString(double num)
  {
    if ( num.ToString().Length < 2 ) {
      return "0" + num.ToString();
    } else {
      return num.ToString();
    }
  }

  /*
   * * * * *
   * MassMotionObject SuperClass that handles geometry conversion to Xml
   */
  abstract class MMObject
  {
    public XmlTextWriter _Writer;
    public string _GlobalID;
    public string _ID;
    public string _Name;
    public string _ObjectSubType;
    public string _ObjectType = "Actor";

    // constructor method
    public MMObject(XmlTextWriter writer, string tag)
    {
      this._ID = "_temp" + tag;
      this._GlobalID = Guid.NewGuid().ToString();
      this._Writer = writer;
    }

    public string Name { get { return this._Name; }}
    public XmlTextWriter Writer { get { return this._Writer; }}
    public string GlobalID {
      get { return this._GlobalID; }
      set { this._GlobalID = value; }
    }
    public string ID {get { return this._ID; }}
    public string ObjectSubType { get { return this._ObjectSubType; }}
    public string ObjectType { get { return this._ObjectType; }}

    // Write this Geometry's attributes to Xml
    public void Write()
    {
      this.Writer.WriteStartElement(this.Name);

      WriteAttributes();
      WriteBody();
      WriteProperty("GlobalID", this.GlobalID, 3);
      WriteProperty("ID", this.ID, 1);
      WriteProperty("Name", this.Name, 3);
      WriteProperty("ObjectSubType", this.ObjectSubType, 3);
      WriteProperty("ObjectType", this.ObjectType, 3);

      this.Writer.WriteEndElement();
    }

    // Write the attributes element of this object
    public virtual void WriteAttributes()
    {
      this.Writer.WriteElementString("Attributes", " ");
    }

    // Write the body element of this object
    // this method can probably be removed
    public virtual void WriteBody()
    {
      this.Writer.WriteStartElement("Body");
      this.Writer.WriteElementString("Attributes", " ");
      this.Writer.WriteElementString("Geometry", " ");
      this.Writer.WriteEndElement();
    }

    // method to write a generic property to the xml file
    public void WriteProperty(string property, string val, int t)
    {
      this.Writer.WriteStartElement(property);
      this.Writer.WriteAttributeString("v", val);
      this.Writer.WriteAttributeString("t", t.ToString());
      this.Writer.WriteEndElement();
    }

    // method to write an object attribute to the xml file
    public void WriteAttribute(string attr, string data, int datat, string type, int typet)
    {
      this.Writer.WriteStartElement(attr);
      WriteProperty("Data", data, datat);
      WriteProperty("Type", type, typet);
      this.Writer.WriteEndElement();
    }

    // method to write the geometry element of a mesh
    public void WriteMeshGeometry(Rhino.Geometry.Mesh msh)
    {
      this.Writer.WriteStartElement("Geometry");
      WriteProperty("Faces", SerializeMeshFaces(msh), 1);
      WriteProperty("GeometryType", "MeshGeometry", 3);
      WriteProperty("Vertices", SerializeMeshVertices(msh), 2);
      this.Writer.WriteEndElement();
    }

    // method to write the geometry element of a polyline
    public void WritePolyLineGeometry(Rhino.Geometry.Polyline pline)
    {
      this.Writer.WriteStartElement("Geometry")
        ;
      this.Writer.WriteStartElement("CurveData");
      this.WriteProperty("RawPoints", SerializePolylineVertices(pline), 2);
      this.Writer.WriteEndElement();

      this.WriteProperty("EdgeRadius", "0.050000", 2);
      this.WriteProperty("GeometryType", "PolylineGeometry", 3);
      this.WriteProperty("VertexRadius", "0.100000", 2);
      this.Writer.WriteEndElement();
    }

    // Returns a string of serialized mesh faces (flattened)
    public string SerializeMeshFaces(Rhino.Geometry.Mesh msh)
    {
      string serialized = "[]";
      List<string> faces = new List<string>();

      msh.Vertices.CombineIdentical(false, false);

      foreach (Rhino.Geometry.MeshFace face in msh.Faces){
        faces.Add(face.A.ToString());
        faces.Add(face.B.ToString());
        faces.Add(face.C.ToString());
        if (face.IsQuad) {
          faces.Add(face.A.ToString());
          faces.Add(face.C.ToString());
          faces.Add(face.D.ToString());
        }
      }
      return serialized.Insert(1, String.Join(",", faces.ToArray()));
    }

    // Returns a string of serialized mesh vertices (flattened)
    public string SerializeMeshVertices(Rhino.Geometry.Mesh msh)
    {
      string serialized = "[]";
      List<string> coords = new List<string>();

      foreach (Rhino.Geometry.Point3d pt in msh.Vertices){
        coords.Add(pt.X.ToString());
        coords.Add(pt.Z.ToString());
        coords.Add((-pt.Y).ToString());
      }
      return serialized.Insert(1, String.Join(",", coords.ToArray()));
    }

    // Returns a string of serialized polyline vertices (flattened)
    public string SerializePolylineVertices(Rhino.Geometry.Polyline pline)
    {
      string serialized = "[]";
      List<string> coords = new List<string>();

      foreach (Rhino.Geometry.Point3d pt in pline){
        coords.Add(pt.X.ToString());
        coords.Add(pt.Z.ToString());
        coords.Add((-pt.Y).ToString());
      }
      return serialized.Insert(1, String.Join(",", coords.ToArray()));
    }

    // Returns a string of serialized list items
    public string SerializeList<T>(List<T> lst)
    {
      string serialized = "[]";
      List<string> serializedList = new List<string>();

      foreach( var item in lst) {
        serializedList.Add(item.ToString());
      }
      return serialized.Insert(1, String.Join(",", serializedList.ToArray()));
    }

    // ## not working
    public string SerializeMeshEdges(Rhino.Geometry.Mesh msh)
    {
      string serialized = "[]";
      return serialized;
    }

    // Returns a joined mesh from a list of meshes
    public Mesh JoinMeshes(List<Mesh> meshes)
    {
      var msh = new Rhino.Geometry.Mesh();
      foreach(Rhino.Geometry.Mesh m in meshes)
      {
        msh.Append(m);
      }
      return msh;
    }
  }


  /*
   * MassMotionCollection Class
   */
  class MMCollection : MMObject
  {

    List<string> _IDs;

    public MMCollection(List<string> ids, XmlTextWriter writer, string tag)
      : base(writer, tag)
    {
      this._ObjectSubType = "GroupCollection";
      this._ObjectType = "Group";
      this._Name = tag;
      this._IDs = ids;
    }

    public List<string> IDs {get {return this._IDs; }}

    public override void WriteAttributes()
    {

      List<float> averages = new List<float>();
      int count = this.IDs.Count;
      for (int i = 0; i < count; i++)
      {
        float average = (1F / count);
        averages.Add(average);
      }

      this.Writer.WriteStartElement("Attributes");
      this.Writer.WriteStartElement("AttrCollectionBaseMembers");
      this.Writer.WriteStartElement("Data");
      this.WriteProperty("GlobalIDs", this.SerializeList(this.IDs), 3);
      this.WriteProperty("WeightedType", "WeightedNone", 3);
      this.WriteProperty("Weights", this.SerializeList(averages), 2);
      this.Writer.WriteEndElement();
      this.WriteProperty("Type", "DataTypeVectorWeightedGlobalID", 3);
      this.Writer.WriteEndElement();
      this.Writer.WriteEndElement();
    }

    public override void WriteBody()
    {
    }
  }

  /*
   * MassMotion Circulation and Journey Class
   */
  class MMCirculate : MMObject
  {
    private string _attr;

    public MMCirculate(string attr, XmlTextWriter writer, string tag)
      : base(writer, tag)
    {
      this._ObjectSubType = tag.Split(":".ToCharArray())[0] == "Journey" ? "EventJourney" : "EventCirculate";
      //this._ObjectSubType = "EventCirculate";
      this._ObjectType = "Event";
      this._Name = tag.Replace(" ", "");
      this._attr = attr;
    }
    public string Attributes { get { return this._attr; }}

    public override void WriteAttributes()
    {
      this.Writer.WriteRaw(this.Attributes);
    }

    public override void WriteBody()
    {
    }
  }


  /*
   * MassMotionFloor Class
   */
  class MMFloor : MMObject
  {
    Rhino.Geometry.Mesh _msh;

    //constructor method
    public MMFloor(Rhino.Geometry.Mesh msh, XmlTextWriter writer, string tag)
      : base(writer, tag)
    {
      this._msh = msh;
      this._ObjectSubType = "FloorActor";
      this._Name = this.Mesh.ToString().Replace(".", "_") + this.ObjectSubType + tag;
    }
    // return the mesh geometry of this object
    public Rhino.Geometry.Mesh Mesh { get { return this._msh; }}

    // Write the body element of this object
    public override void WriteBody()
    {
      this.Writer.WriteStartElement("Body");
      this.WriteMeshGeometry(this.Mesh);
      this.Writer.WriteEndElement();
    }
  }

  /*
   * MassMotionBarrier Class
   */
  class MMBarrier : MMObject
  {
    Rhino.Geometry.Mesh _msh;

    //constructor method
    public MMBarrier(Rhino.Geometry.Mesh msh, XmlTextWriter writer, string tag)
      : base(writer, tag)
    {
      this._msh = msh;
      this._ObjectSubType = "BarrierActor";
      this._Name = this.Mesh.ToString().Replace(".", "_") + this.ObjectSubType + tag;
    }
    // return the mesh geometry of this object
    public Rhino.Geometry.Mesh Mesh { get { return this._msh; }}

    // Write the body element of this object
    public override void WriteBody()
    {
      this.Writer.WriteStartElement("Body");
      this.WriteMeshGeometry(this.Mesh);
      this.Writer.WriteEndElement();
    }
  }

  /*
   * MassMotionLink Class
   */
  class MMLink : MMObject
  {
    Rhino.Geometry.Mesh _msh;

    // contructor method
    public MMLink(Rhino.Geometry.Mesh msh, XmlTextWriter writer, string tag)
      : base(writer, tag)
    {
      this._msh = msh;
      this._msh.Translate(new Vector3d(0, 0, 0.05));
      this._ObjectSubType = "LinkActor";
      this._Name = this.Mesh.ToString().Replace(".", "_") + this.ObjectSubType + tag;
    }
    // return the mesh geometry of this object
    public Rhino.Geometry.Mesh Mesh { get { return this._msh; }}

    // Write the body element of this object
    public override void WriteBody()
    {

      this.Writer.WriteStartElement("Body");

      this.Writer.WriteStartElement("Attributes");
      this.WriteAttribute("AttrCEActorGoalPointPositions",
        this.SerializeMeshVertices(this.Mesh), 2,
        "DataTypeVectorDouble", 3);
      this.WriteAttribute("AttrCEActorGoalVertexIndices",
        "[1,3,2,0]", 1,
        "DataTypeVectorInt", 3);
      this.Writer.WriteEndElement();
      this.WriteMeshGeometry(this.Mesh);
      this.Writer.WriteEndElement();
    }
  }
  /*
   * MassMotionPortal Class
   */
  class MMPortal : MMObject
  {
    Rhino.Geometry.Mesh _msh;

    // contructor method
    public MMPortal(Rhino.Geometry.Mesh msh, XmlTextWriter writer, string tag)
      : base(writer, tag)
    {
      this._msh = msh;
      this._msh.Translate(new Vector3d(0, 0, 0.05));
      this._ObjectSubType = "PortalActor";
      this._Name = this.Mesh.ToString().Replace(".", "_") + this.ObjectSubType + tag;
    }
    // return the mesh geometry of this object
    public Rhino.Geometry.Mesh Mesh { get { return this._msh; }}

    // Write the body element of this object
    // This currently is not outputting the correct locations for:
    //  - AttrPortalGoalEdgeIndices and
    //  - AttrPortalGoalPointPositions
    public override void WriteBody()
    {
      this.Writer.WriteStartElement("Body");

      this.Writer.WriteStartElement("Attributes");
      this.WriteAttribute("AttrPortalGoalEdgeIndices",
        "[1,4]", 1,
        "DataTypeVectorInt", 3);
      this.WriteAttribute("AttrPortalGoalPointPositions",
        "temp", 2,
        "DataTypeVectorDouble", 3);
      this.Writer.WriteEndElement();
      this.WriteMeshGeometry(this.Mesh);
      this.Writer.WriteEndElement();
    }
  }

  /*
   * MassMotionPath Class
   */
  class MMPath : MMObject
  {
    Rhino.Geometry.Polyline _pline;

    public MMPath(Rhino.Geometry.Polyline pline, XmlTextWriter writer, string tag)
      : base(writer, tag)
    {
      this._pline = pline;
      this._ObjectSubType = "PathActor";
      this._Name = this.Pline.ToString().Replace(".", "_") + this.ObjectSubType + tag;
    }
    // return the polyline geometry of this object
    public Rhino.Geometry.Polyline Pline { get { return this._pline; }}

    // Write the body element of this object
    public override void WriteBody()
    {
      this.Writer.WriteStartElement("Body");
      this.WritePolyLineGeometry(this.Pline);
      this.Writer.WriteEndElement();
    }
  }

  /*
   * MassMotion VisualizationOnly Class
   */
  class MMVisOnly : MMObject
  {
    Rhino.Geometry.Mesh _msh;

    //constructor method
    public MMVisOnly(Rhino.Geometry.Mesh msh, XmlTextWriter writer, string tag)
      : base(writer, tag)
    {
      this._msh = msh;
      this._ObjectSubType = "VisOnlyActor";
      this._Name = this.Mesh.ToString().Replace(".", "_") + this.ObjectSubType + tag;
    }
    // return the mesh geometry of this object
    public Rhino.Geometry.Mesh Mesh { get { return this._msh; }}

    // Write the body element of this object
    public override void WriteBody()
    {
      this.Writer.WriteStartElement("Body");
      this.WriteMeshGeometry(this.Mesh);
      this.Writer.WriteEndElement();
    }
  }
# ---------- end mass_motion_export ----------
panel_16 = Panel(mass_motion_export.out)  # disabled
mass_motion_export_2 = CSharpScript(
    floors=[mesh_9, mesh_10],
    barriers=[mesh_8, mesh_7],
    links=mesh_11,
    portals=[mesh_5, mesh_6],
    journeys=[journey_3.A, journey_2.A],
    simTime=" 0 to 150",
    filePath=panel_13,
    fileName="rhino_export",
    run=Toggle(True))  # -> out, A; inputs floors: tree of Mesh, barriers: tree of Mesh, paths: tree of Polyline, links: tree of Mesh, portals: tree of Mesh, geometry: tree of Mesh, journeys: tree of String, filePath: String, fileName: String, run: Boolean; same code as mass_motion_export
panel_17 = Panel(mass_motion_export_2.out)
