# Grasshopper definition debug.gh (Grasshopper 0.9.76)
# plug-ins: MMBuilder

rectangle = Rectangle(Plane=PlaneXY(0, 0, 0), XSize=Domain(-1, 1), YSize=Domain(-2, 2), Radius=0)  # -> Rectangle, Length
rectangle_2 = Rectangle(Plane=PlaneXY(0, 0, 0), XSize=Domain(-1, 1), YSize=Domain(-2, 2), Radius=0)  # -> Rectangle, Length
rectangle_3 = Rectangle(Plane=PlaneXY(0, 0, 0), XSize=Domain(-1, 1), YSize=Domain(-2, 2), Radius=0)  # -> Rectangle, Length
mesh = Mesh(rectangle.Rectangle)
mesh_2 = Mesh(rectangle_2.Rectangle)
mesh_3 = Mesh(rectangle_3.Rectangle)
mmjourney = MMJourney(
    StartPortals=mesh,
    EndPortals=mesh_2,
    DwellPortals=mesh_3,
    DwellTime="0 to 16",
    AgentNum=Slider(10, range=0..10),
    SimTime="0 to 30",
    Name="test")
mmexport = MMExport(
    Portals=[mesh_2, mesh, mesh_3],
    Journeys=mmjourney,
    FilePath="H:\_git\massmotion-export\test",
    FileName="debug",
    Run=Toggle(True))
